# Dynamo graph AUTO-ID_CIVIL3D_V3.0.dyn "COMPILADO MEJ-N Y SUP-N" (Dynamo 2.19.4.6671)

# group: 01. WORKSPACE
# Se abre el arcivo y se prepara el workspace (ModelSpace)
objects_types = AcObjectTypes("Solid")
current = Autodesk.AutoCAD.DynamoNodes.Document.Current()
modelSpace = Autodesk.AutoCAD.DynamoNodes.Document.ModelSpace(document=current)

# group: 02. PROPERTY SETS
# Obtiene los property sets
all_objects_of_type = AcObjectsOfType(type=objects_types, block=modelSpace)  # graph output
propertySets = Autodesk.AutoCAD.DynamoNodes.Object.PropertySets(object=all_objects_of_type)
flatten = List.Flatten(list=propertySets)

# group: 03. IDENTIFICACIÓN PROPERTY SET
# Obtiene el primer grupo de los property sets (01_IDENTIFICACION)
string = StringInput("01_IDENTIFICACION")
name = Autodesk.AutoCAD.DynamoNodes.PropertySet.Name(propertySet=flatten)
eq = name == string
filterByBoolMask = List.FilterByBoolMask(list=flatten, mask=eq)

string_2 = StringInput("01_08_NUM_ID")

# group: 04. NOMBRE DEL ELEMENTO
# Obtiene el sub property set dentro de 01_IDENTIFICACION que contiene el nombre del elemento (01_07_ELEMENTO)
properties = Autodesk.AutoCAD.DynamoNodes.PropertySet.Properties(propertySet=filterByBoolMask.in)

python_script = Python(IN[0]=properties)  # CPython3
# ---------- python_script.python (77 lines) ----------
# Entrada desde Dynamo
listas_propiedades = IN[0]  # Lista de listas de objetos tipo "Property"

# Crear una lista para almacenar las propiedades
propiedades = []
values = []
#Contadores
contador_BTCN = 0
contador_CUNN = 0
contador_LSMN = 0
contador_MDCN = 0
contador_MEJN= 0
contador_NAN = 0
contador_SBGN = 0
contador_SUPN = 0

# Iterar sobre cada lista en el conjunto de listas
for lista in listas_propiedades:
    
    # Iterar sobre cada propiedad dentro de la lista para encontrar 01_07_ELEMENTO
    for propiedad in lista:
        
        #Obtiene el valor de la propiedad 01_07_ELEMENTO
        if propiedad.Name == "01_07_ELEMENTO":
            
            #Nombre del elemento
            nombre_elemento = propiedad.Value
        
            #Actualiza contadores y asigna valor a 01_08_NUM_ID
            if nombre_elemento == "BTC-N":
                contador_BTCN+= 1
                contador_general = contador_BTCN
            
            elif nombre_elemento == "CUN-N":
                contador_CUNN+=1
                contador_general = contador_CUNN
            
            elif nombre_elemento == "LSM-N":
                contador_LSMN+=1
                contador_general = contador_LSMN
            
            elif nombre_elemento == "MDC-N":
                contador_MDCN+=1
                contador_general = contador_MDCN
            
            elif nombre_elemento == "MEJ-N":
                contador_MEJN+=1
                contador_general = contador_MEJN
            
            elif nombre_elemento == "NA-N":
                contador_NAN+=1
                contador_general = contador_NAN
            
            elif nombre_elemento == "SBG-N":
                contador_SBGN+=1
                contador_general = contador_SBGN
            
            elif nombre_elemento == "SUP-N":
                contador_SUPN+=1
                contador_general = contador_SUPN
            
            break


    # Iterar sobre cada propiedad dentro de la lista para encontrar 01_08_NUM_ID
    for propiedad in lista: 

        #Obtiene el valor de la propiedad 001_08_NUM_ID
        if propiedad.Name == "01_08_NUM_ID": 

            propiedad.Value = str(contador_general).zfill(4)  # Convierte el número a un string con 4 dígitos
            
            values.append(str(contador_general).zfill(4))

            break
     
OUT = values
# ----------------------------------------
updateProperty = Autodesk.AutoCAD.DynamoNodes.Object.UpdateProperty(object=all_objects_of_type, propertySetName=string, propertyName=string_2, propertyValue=python_script)
