# Dynamo graph CUN-N_CIVIL3D_V3.0.dyn (Dynamo 2.19.4.6671)

# group: 01. WORKSPACE
# Se abre el arcivo y se prepara el workspace (ModelSpace)
objects_types = AcObjectTypes("Solid")
current = Autodesk.AutoCAD.DynamoNodes.Document.Current()
modelSpace = Autodesk.AutoCAD.DynamoNodes.Document.ModelSpace(document=current)

# group: 02. PROPERTY SETS
# Obtiene los property sets
all_objects_of_type = AcObjectsOfType(type=objects_types, block=modelSpace)  # graph output
propertySets = Autodesk.AutoCAD.DynamoNodes.Object.PropertySets(object=all_objects_of_type)
flatten = List.Flatten(list=propertySets)

# group: 03. IDENTIFICACIÓN PROPERTY SET
# Obtiene el primer grupo de los property sets (01_IDENTIFICACION)
name = Autodesk.AutoCAD.DynamoNodes.PropertySet.Name(propertySet=flatten)
string = StringInput("01_IDENTIFICACION")
eq = name == string
filterByBoolMask = List.FilterByBoolMask(list=flatten, mask=eq)

# group: 04. NOMBRE DEL ELEMENTO
# Obtiene el sub property set dentro de 01_IDENTIFICACION que contiene el nombre del elemento (01_07_ELEMENTO)
properties = Autodesk.AutoCAD.DynamoNodes.PropertySet.Properties(propertySet=filterByBoolMask.in)
name_2 = Autodesk.AutoCAD.DynamoNodes.Property.Name(property=properties)
string_2 = StringInput("01_07_ELEMENTO")
eq_2 = name_2 == string_2
filterByBoolMask_2 = List.FilterByBoolMask(list=properties, mask=eq_2)
flatten_2 = List.Flatten(list=filterByBoolMask_2.in)

# group: 05. ELEMENTOS CUN-N
# Obtiene todos los elementos cuyo nombre del sub property set (01_07_ELEMENTO) sea igual a CUN-N
value = Autodesk.AutoCAD.DynamoNodes.Property.Value(property=flatten_2)
string_3 = StringInput("CUN-N")
eq_3 = value == string_3
filterByBoolMask_3 = List.FilterByBoolMask(list=properties, mask=eq_3)

# group: 06. SUBPROPERTY SET 01_08_NUM ID
# Obtiene la subproperty set que corresponde al ID de cada elemento
name_3 = Autodesk.AutoCAD.DynamoNodes.Property.Name(property=filterByBoolMask_3.in)
string_4 = StringInput("01_08_NUM_ID")
eq_4 = name_3 == string_4
filterByBoolMask_4 = List.FilterByBoolMask(list=filterByBoolMask_3.in, mask=eq_4)
flatten_3 = List.Flatten(list=filterByBoolMask_4.in)

# group: A. SECUENCIA
# Prepara el identificador para asignar al ID de cada elemento
number = DoubleInput(1)
count = List.Count(list=filterByBoolMask_3.in)
number_2 = DoubleInput(1)
sequence = Sequence(start=number, amount=count, step=number_2)
string_from_object = FromObject(object=sequence)
number_3 = DoubleInput(4)
string_5 = StringInput("0")
padLeft = String.PadLeft(string=string_from_object, newLength=number_3, padChars=string_5)

# group: 07. UPDATE DEL SUBPROPERTY
# Hace el push de la actualización de la propiedad
updateProperty = Autodesk.AutoCAD.DynamoNodes.Object.UpdateProperty(object=all_objects_of_type, propertySetName=string, propertyName=string_4, propertyValue=padLeft)

# group: 08. VERIFICACIÓN
# Verificación de la asginación de la propiedad
propertySets_2 = Autodesk.AutoCAD.DynamoNodes.Object.PropertySets(object=updateProperty)
flatten_4 = List.Flatten(list=propertySets_2)
name_4 = Autodesk.AutoCAD.DynamoNodes.PropertySet.Name(propertySet=flatten_4)
string_6 = StringInput("01_IDENTIFICACION")
eq_5 = name_4 == string_6
filterByBoolMask_5 = List.FilterByBoolMask(list=flatten_4, mask=eq_5)
properties_2 = Autodesk.AutoCAD.DynamoNodes.PropertySet.Properties(propertySet=filterByBoolMask_5.in)
name_5 = Autodesk.AutoCAD.DynamoNodes.Property.Name(property=properties_2)
string_7 = StringInput("01_08_NUM_ID")
eq_6 = name_5 == string_7
filterByBoolMask_6 = List.FilterByBoolMask(list=properties_2, mask=eq_6)
flatten_5 = List.Flatten(list=filterByBoolMask_6.in)
value_2 = Autodesk.AutoCAD.DynamoNodes.Property.Value(property=flatten_5)
